# Dynamo graph stage5_profile_view.dyn (Dynamo 3.3.1.7726)

# group: Main
string = StringInput("Combined Paste")
string_2 = StringInput("\\wsl.localhost\Ubuntu-24.04\home\wsl\work\project\dynamo-python-node-docs-v1\data\stage3_crossings.ddb")
string_3 = StringInput("YCC- WASTEWATER NETWORK")
reload_tocken = IntegerSlider(17, range=0..100 step 1)
python_script = Python(IN[0]=string, IN[1]=string_2, IN[2]=string_3, IN[3]=reload_tocken)  # CPython3
# ---------- python_script.python (49 lines) ----------
import sys, clr, importlib, traceback

clr.AddReference("AcMgd"); clr.AddReference("AcCoreMgd"); clr.AddReference("AcDbMgd")
clr.AddReference("AecBaseMgd"); clr.AddReference("AecPropDataMgd"); clr.AddReference("AeccDbMgd")
 
from Autodesk.AutoCAD.ApplicationServices.Core import Application
from Autodesk.Civil.ApplicationServices import CivilApplication

# --- repo path (edit to your clone) ---
REPO = r"\\wsl.localhost\Ubuntu-24.04\home\wsl\work\project\dynamo-python-node-docs-v1"
if REPO not in sys.path:
    sys.path.insert(0, REPO)
    sys.path.append(f"{REPO}/Site-packages")

def unload_package(package_name):
    for name in list(sys.modules.keys()):
        if name == package_name or name.startswith(package_name + "."):
            del sys.modules[name]

# --- active document context ---
doc    = Application.DocumentManager.MdiActiveDocument
db     = doc.Database
ed     = doc.Editor
civdoc = CivilApplication.ActiveDocument

results = {"Success": False, "Warnings": [], "Errors": [], "Skipped": [], "Data": None}
RAISE_ON_ERROR = False

try:
    importlib.invalidate_caches()
    unload_package("automations")                                  # drop cached modules
    mod = importlib.import_module("automations.stage5_profile_views")

    with doc.LockDocument():
        with db.TransactionManager.StartTransaction() as tr:
            context = {"doc": doc, "db": db, "ed": ed,
                       "civdoc": civdoc, "tr": tr, "IN": IN}
            results["Data"] = mod.run(context)                     # module does the work
            tr.Commit()

    results["Success"] = True
    results["ModuleFile"] = getattr(mod, "__file__", None)         # confirms which file ran
except Exception as ex:
    results["Errors"].append(str(ex))
    results["Traceback"] = traceback.format_exc()
    if RAISE_ON_ERROR:
        raise

OUT = results
# ----------------------------------------
watch = Watch(python_script)

# group: Test one crossing in modelspace
code_block = CodeBlock { x["Data"]["Crossings"][4792]; }  # frozen; unwired: x
watch_2 = Watch(code_block)
code_block_2 = CodeBlock(x=code_block) { x[7]; x[8]; x[9]; }
byCoordinates = Point.ByCoordinates(x=code_block_2.out0, y=code_block_2.out1, z=code_block_2.out2)
watch_3 = Watch(byCoordinates)
integer_slider = IntegerSlider(63, range=0..100 step 1)
byCenterPointRadius = Circle.ByCenterPointRadius(centerPoint=byCoordinates, radius=integer_slider)
watch_4 = Watch(byCenterPointRadius)
string_4 = StringInput("Testing")
byGeometry = Autodesk.AutoCAD.DynamoNodes.Object.ByGeometry(geometry=byCoordinates, layerName=string_4)
watch_5 = Watch(byGeometry)
string_5 = StringInput("Testing")
byGeometry_2 = Autodesk.AutoCAD.DynamoNodes.Object.ByGeometry(geometry=byCenterPointRadius, layerName=string_5)
watch_6 = Watch(byGeometry_2)
